% Simulink data dictionary F28379D_benchTest_CPU1.sldd

LedState_e = enum(DefaultValue="Off", StorageType="uint8", AddClassNameToEnumNames=true)
  Off = 0
  On = 1

motorEnable = Simulink.Parameter(0, StorageClass="ExportedGlobal", DataType="uint16", Min=0, Max=1, Unit="boolean")
motorControlMode = Simulink.Parameter(motorControlModes.Off, StorageClass="ExportedGlobal", DataType="Enum: motorControlModes", Unit="motorControlModes")

motorControlModes = enum(DataScope="Exported", DefaultValue="Off", StorageType="uint16", AddClassNameToEnumNames=true)
  Off = 0
  PWM = 1
  Position = 2

generalInput = Simulink.Parameter(30000, StorageClass="ExportedGlobal", DataType="uint16", Min=0, Max=60000, Unit="cnt")
motorPosGainP = Simulink.Parameter(2000, StorageClass="ExportedGlobal", DataType="uint16", Min=0, Max=10000, Unit="mCount")
motorPosGainI = Simulink.Parameter(0, StorageClass="ExportedGlobal", DataType="uint16", Min=0, Max=10000, Unit="mCount")
motorVelGainI = Simulink.Parameter(2000, StorageClass="ExportedGlobal", DataType="uint16", Min=0, Max=10000, Unit="mCount")

throttlePosInputModes = enum(DataScope="Exported", DefaultValue="Disabled", StorageType="uint16", AddClassNameToEnumNames=true)
  Disabled = 0
  CCP = 1
  VectorBox = 2

throttlePosInputMode = Simulink.Parameter(throttlePosInputModes.Disabled, StorageClass="ExportedGlobal", DataType="Enum: throttlePosInputModes", Unit="throttlePosInputMode")
Sig = Simulink.Signal()

etcModes = enum(DataScope="Exported", DefaultValue="ESTOP", StorageType="uint16", AddClassNameToEnumNames=true)
  ESTOP = 0
  Standby = 1
  Run = 2
  Diag = 3

motorVelGainP = Simulink.Parameter(200, StorageClass="ExportedGlobal", DataType="uint16", Min=0, Max=10000, Unit="mCount")
motorVelGainFeedback = Simulink.Parameter(200, StorageClass="ExportedGlobal", DataType="uint16", Min=0, Max=10000, Unit="mCount")
motorCurrZero_mV = Simulink.Parameter(1651, StorageClass="ExportedGlobal", DataType="uint16", Min=0, Max=3300, Unit="mV")

etcSubModes = enum(DataScope="Exported", DefaultValue="Disabled", StorageType="uint16", AddClassNameToEnumNames=true)
  Disabled = 0
  Normal = 1
  Calibration = 2
  PWMControl = 3
  PositionControl = 4

etcSubModeCmd = Simulink.Parameter(etcSubModes.Disabled, StorageClass="ExportedGlobal", DataType="Enum: etcSubModes", Unit="etcSubModes")
etcModeCmd = Simulink.Parameter(etcModes.ESTOP, StorageClass="ExportedGlobal", DataType="Enum: etcModes", Unit="etcModes")
battVoltFaultThresh_mV = Simulink.Parameter(5000, StorageClass="ExportedGlobal", DataType="uint16", Min=0, Max=20000, Unit="mV")
motorBPWM = Simulink.Parameter(0, StorageClass="ExportedGlobal", DataType="uint16", Min=0, Max=100, Unit="pct")
motorAPWM = Simulink.Parameter(0, StorageClass="ExportedGlobal", DataType="uint16", Min=0, Max=100, Unit="pct")
throttlePos2Max_cnt = Simulink.Parameter(3940, StorageClass="ExportedGlobal", DataType="uint16", Min=0, Max=4095, Unit="cnt")
throttlePos2Min_cnt = Simulink.Parameter(435, StorageClass="ExportedGlobal", DataType="uint16", Min=0, Max=4095, Unit="cnt")
boardTempTemperatureCal_mC = Simulink.Parameter(29200, StorageClass="ExportedGlobal", DataType="uint16", Min=0, Max=65000, Unit="mC")
boardTempVoltageCal_mV = Simulink.Parameter(590, StorageClass="ExportedGlobal", DataType="uint16", Min=0, Max=10000, Unit="mV")
motorDriverTempVoltageCal_mV = Simulink.Parameter(588, StorageClass="ExportedGlobal", DataType="uint16", Min=0, Max=10000, Unit="mV")
motorDriverTempTemperatureCal_mC = Simulink.Parameter(29600, StorageClass="ExportedGlobal", DataType="uint16", Min=0, Max=65000, Unit="mC")
model_springConstant = Simulink.Parameter(200, StorageClass="ExportedGlobal", DataType="uint16", Min=0, Max=1000, Unit="mNM")
model_springPreload = Simulink.Parameter(800, StorageClass="ExportedGlobal", DataType="uint16", Min=0, Max=1000, Unit="mNM")
motorPWMFreq = Simulink.Parameter(35000, StorageClass="ExportedGlobal", DataType="uint16", Min=0, Max=60000, Unit="Hz")
throttlePos1Min_cnt = Simulink.Parameter(3670, StorageClass="ExportedGlobal", DataType="uint16", Min=0, Max=4095, Unit="cnt")
throttlePos1Max_cnt = Simulink.Parameter(165, StorageClass="ExportedGlobal", DataType="uint16", Min=0, Max=4095, Unit="cnt")
motorPosCommand_pct = Simulink.Parameter(0, StorageClass="ExportedGlobal", DataType="uint16", Min=0, Max=100, Unit="pct")