% Simulink data dictionary etc_benchTest.sldd

LedState_e = enum(DefaultValue="Off", StorageType="uint8", AddClassNameToEnumNames=true)
  Off = 0
  On = 1

model_springConstant = Simulink.Parameter(87, StorageClass="ExportedGlobal", DataType="uint16", Min=0, Max=1000, Unit="mNM")
model_springPreload = Simulink.Parameter(396, StorageClass="ExportedGlobal", DataType="uint16", Min=0, Max=1000, Unit="mNM")
motor1PWM = Simulink.Parameter(0, StorageClass="ExportedGlobal", DataType="uint16", Min=0, Max=100, Unit="pct")
motor2PWM = Simulink.Parameter(0, StorageClass="ExportedGlobal", DataType="uint16", Min=0, Max=100, Unit="pct")
motorCurrZero_mV = Simulink.Parameter(1649, StorageClass="ExportedGlobal", DataType="uint16", Min=0, Max=3300, Unit="mV")
motorEnable = Simulink.Parameter(0, StorageClass="ExportedGlobal", DataType="uint16", Min=0, Max=1, Unit="boolean")
motorPWMFreq = Simulink.Parameter(10000, StorageClass="ExportedGlobal", DataType="uint16", Min=0, Max=60000, Unit="Hz")
throttlePos1Max_cnt = Simulink.Parameter(3895, StorageClass="ExportedGlobal", DataType="uint16", Min=0, Max=4095, Unit="cnt")
throttlePos1Min_cnt = Simulink.Parameter(430, StorageClass="ExportedGlobal", DataType="uint16", Min=0, Max=4095, Unit="cnt")
throttlePos2Max_cnt = Simulink.Parameter(3680, StorageClass="ExportedGlobal", DataType="uint16", Min=0, Max=4095, Unit="cnt")
throttlePos2Min_cnt = Simulink.Parameter(180, StorageClass="ExportedGlobal", DataType="uint16", Min=0, Max=4095, Unit="cnt")
motorControlMode = Simulink.Parameter(motorControlModes.Off, StorageClass="ExportedGlobal", DataType="Enum: motorControlModes", Unit="motorControlModes")

motorControlModes = enum(DataScope="Exported", DefaultValue="Off", StorageType="uint16", AddClassNameToEnumNames=true)
  Off = 0
  PWM = 1
  Position = 2

motorPosCommand_deg = Simulink.Parameter(0, StorageClass="ExportedGlobal", DataType="uint16", Min=0, Max=90, Unit="cnt")
motorPosGainP = Simulink.Parameter(2, StorageClass="ExportedGlobal", DataType="uint16", Min=0, Max=100)
motorPosGainI = Simulink.Parameter(0, StorageClass="ExportedGlobal", DataType="uint16", Min=0, Max=100)
motorVelGainP = Simulink.Parameter(1, StorageClass="ExportedGlobal", DataType="uint16", Min=0, Max=100)
generalInput = Simulink.Parameter(30000, StorageClass="ExportedGlobal", DataType="uint16", Min=0, Max=60000, Unit="cnt")
motorVelGainI = Simulink.Parameter(0, StorageClass="ExportedGlobal", DataType="uint16", Min=0, Max=100)